# Grasshopper definition RealTimeControlExampleFile.gh (Grasshopper 1.0.7)
# plug-ins: BridgeTools

# ---- group: open in browser
websocket_viewer = Panel("http://127.0.0.1:8090/")

# ---- group: Connected?
ping = CheckConnection(Ping=Toggle(False), Host="http://127.0.0.1:8090")  # -> Ok, Ts, Msg
status = Panel(ping.Msg)

# ----
listen = Listen(Host="http://127.0.0.1:8090", Auto=True, IntervalMs=500, Bang=False)  # -> LinesTotal, LinesDone, LinesRemain, PointsTotal, PointsDone, PointsRemain, Version, LastLine, Msg, LastTs

# ---- group: SEND!!
send = SendGcode(Send=Button(), GCode="g-code lines", Host="http://127.0.0.1:8090", DelayMs=-1)
panel = Panel(send)

# ---- group: status
total_lines_sent = Panel(listen.LinesTotal)
lines_done = Panel(listen.LinesDone)
lines_remaining = Panel(listen.LinesRemain)
last_line_tcp = Panel(listen.LastLine)
